# Grasshopper definition UWG_KBEM_020821.gh (Grasshopper 1.0.7)
# plug-ins: Pufferfish

bldgprograms = Honeybee_bldgPrograms({"Office": 0, "Retail": 1, "MidriseApartment": 2, "PrimarySchool": 3, "SecondarySchool": 4, "SmallHotel": 5, "LargeHotel": 6, "Hospital": 7, "Outpatient": 8, "Warehouse": 9, "SuperMarket": 10, "FullServiceRestaurant": 11, "QuickServiceRestaurant": 12}, selected="MidriseApartment")  # disabled
panel = Panel("ClgSetp to 0")  # disabled
listzoneprograms = Honeybee_ListZonePrograms(bldgProgram=bldgprograms)  # -> MidriseApartmentZonePrograms; disabled; plug-in component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
honeybee = Honeybee_Honeybee()  # -> Vviiiiiiiiiizzz; disabled; plug-in component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
item = ListItem(List=listzoneprograms, Index=0, Wrap=True)  # disabled
geteploads = Honeybee_GetEnergyPlusLoads(zoneProgram=item)  # -> equipmentLoadPerArea, infilRatePerArea_Facade, lightingDensityPerArea, numOfPeoplePerArea, ventilationPerArea, ventilationPerPerson; disabled; plug-in component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
getepschedules = Honeybee_GetEnergyPlusSchedules(zoneProgram=item)  # -> occupancySchedule, occupancyActivitySch, heatingSetPtSchedule, coolingSetPtSchedule, lightingSchedule, equipmentSchedule, infiltrationSchedule; disabled; plug-in component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
decomposeepsch = Honeybee_DecomposeEnergyPlusSchedule(schName=getepschedules.coolingSetPtSchedule)  # -> name, schedule, comments; disabled; plug-in component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
panel_2 = Panel([geteploads.equipmentLoadPerArea, geteploads.infilRatePerArea_Facade, geteploads.lightingDensityPerArea, geteploads.numOfPeoplePerArea, geteploads.ventilationPerArea, geteploads.ventilationPerPerson])  # disabled
panel_3 = Panel(getepschedules.heatingSetPtSchedule)  # disabled
convertepschvalues = Honeybee_ConvertEnergyPlusScheduleToValues(schName=getepschedules.occupancySchedule)  # -> values, holidays; disabled; plug-in component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
strnum = Ladybug_SeparateData(inputList=flatten(convertepschvalues.values))  # -> numbers, strings; disabled; plug-in component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
panel_4 = Panel(strnum.numbers)  # disabled
graph = QuickGraph(strnum.numbers, SortOrder=0)  # disabled

geo = Geometry()

geo_2 = Geometry(geo)
len = Length(Curve=geo_2)
round = Round(Number=len)  # -> Nearest, Floor, Ceiling
division = Division(A=round.Nearest, B="25")
divide = DivideCurve(Curve=geo_2, Count=division, Kinks=False)  # -> simplify(Points), Tangents, Parameters

area = Area(Geometry=geo)  # -> Area, Centroid
disc = Discontinuity(Curve=geo, Level=1)  # -> Points, Parameters
merge = Merge(Data1=area.Centroid, Data2=disc.Points)  # -> flatten(Result)
hull = ConvexHull(Points=merge, Plane=PlaneXY(0, 0, 0))  # -> Hull, HullZ, Indices

fline = FitLine(Points=divide.Points)
len_2 = Length(Curve=fline)
round_2 = Round(Number=len_2)  # -> Nearest, Floor, Ceiling
division_2 = Division(A=round_2.Nearest, B="25")
divide_2 = DivideCurve(Curve=fline, Count=division_2, Kinks=False)  # -> Points, Tangents, Parameters
incurves = PointInCurves(Point=divide_2.Points, Curves=graft(geo_2))  # -> Relationship, Index, Point
equals = Equality(FirstNumber=incurves.Relationship, SecondNumber="2")  # -> Equality, Inequality
dispatch = Dispatch(List=divide_2.Points, DispatchPattern=equals.Equality)  # -> ListA, ListB

area_2 = Area(Geometry=hull.Hull)  # -> Area, Centroid
simplify = SimplifyCurve(Curve=hull.Hull, Tolerance="30", AngleTolerance="30")  # -> Curve, Simplified
debrep = DeconstructBrep(Brep=simplify.Curve)  # -> Faces, Edges, Vertices
Z = UnitZ(Factor=Slider(30, range=0..100))
hull_2 = ConvexHull(Points=debrep.Vertices, Plane=PlaneXY(0, 0, 0))  # -> Hull, HullZ, Indices
area_3 = Area(Geometry=hull_2.Hull)  # -> Area, Centroid

pt = Point([Point(485147, 4421782, 0), Point(485013, 4421937, 0), Point(485013, 4421984, 0), Point(485015, 4422009, 0), Point(485442, 4421903, 0), Point(485438, 4421976, 0)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])
circle = CircleCNR(Center=pt, Normal=Vector(0, 0, 1), Radius="40")

scale2area = ScaleToArea(Geometry=hull_2.Hull, Plane=area_3.Centroid, Area=area_2.Area, FactorX=1, FactorY=1, FactorZ=1)  # -> Scaled, Transform
boundary = BoundarySurfaces(Edges=scale2area.Scaled)

incurves_2 = PointInCurves(Point=divide.Points, Curves=circle)  # -> Relationship, Index, Point
equals_2 = Equality(FirstNumber=incurves_2.Relationship, SecondNumber="0")  # -> Equality, Inequality
dispatch_2 = Dispatch(List=divide.Points, DispatchPattern=equals_2.Equality)  # -> ListA, ListB

geo_3 = Geometry([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])
panel_5 = Panel("""Bahcelievler
Residentail""")

geo_4 = Geometry([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])
panel_6 = Panel("""Bahcelievler
Parcels""")

geo_5 = Geometry([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])
panel_7 = Panel("""Bahcelievler
School""")

geo_6 = Geometry([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])
panel_8 = Panel("""Bahcelievler
Commercial""")

preview = CustomPreview(Geometry=boundary, Material=ColourSwatch(SwatchColor=RGB(92, 92, 92)))

panel_9 = Panel("""Periphery
Residential""")
geo_7 = Geometry([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])

panel_10 = Panel("""Periphery
Commercial""")
geo_8 = Geometry([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])

panel_11 = Panel("""Periphery
Parcels""")
geo_9 = Geometry([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])

# ----
# Terrain
boundary_2 = BoundarySurfaces(Edges=geo_9)  # disabled
merge_2 = Merge(Data1=boundary_2, Data2=boundary)  # disabled

merge_3 = Merge(Data1=dispatch_2.ListA, Data2=dispatch.ListA)  # -> flatten(Result)
polygon = Polygon(Plane=merge_3, Radius="8", Segments="4", FilletRadius=0)  # -> Polygon, Length
area_4 = Area(Geometry=polygon.Polygon)  # -> Area, Centroid
rad = Radians(Degrees="45")
# Trees
rotate = Rotate(Geometry=polygon.Polygon, Angle=rad, Plane=area_4.Centroid)  # -> Geometry, Transform

panel_12 = Panel("""Yukarı Bahcelievler
Residential""")
geo_10 = Geometry([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])

panel_13 = Panel("""Yukarı Bahcelievler
Parcels""")
geo_11 = Geometry([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])

entwine = Entwine(Branch00=geo_4, Branch01=geo_11, FlattenInputs=True)  # -> flatten(Result)
area_5 = Area(Geometry=entwine)  # -> Area, Centroid
ma = MassAddition(Input=area_5.Area)  # -> Result, PartialResults

panel_14 = Panel("""Yukarı Bahcelievler
Commercial""")
geo_12 = Geometry([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])

panel_15 = Panel("""Yukarı Bahcelievler
School""")
geo_13 = Geometry([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])

entwine_2 = Entwine(Branch00=geo_3, Branch01=geo_6, Branch02=geo_5, Branch03=geo_10, Branch04=geo_12, Branch05=geo_13, FlattenInputs=True)  # -> flatten(Result)
extr = Extrude(Base=entwine_2, Direction=Z)
debrep_2 = DeconstructBrep(Brep=extr)  # -> flatten(Faces), Edges, Vertices
area_6 = Area(Geometry=entwine_2)  # -> Area, Centroid
area_7 = Area(Geometry=debrep_2.Faces)  # -> Area, Centroid
ma_2 = MassAddition(Input=area_7.Area)  # -> Result, PartialResults
division_3 = Division(A=ma_2.Result, B=ma.Result)
panel_16 = Panel(division_3)

panel_17 = Panel("""Emek
Residential""")
geo_14 = Geometry([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])

panel_18 = Panel("""Emek
Parcels""")
geo_15 = Geometry(<curve referenced from the Rhino model>)

panel_19 = Panel("""Emek
Commercial""")
geo_16 = Geometry([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])

panel_20 = Panel("""Emek
School""")
geo_17 = Geometry([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])

panel_21 = Panel("Grass of Periphery")
geo_18 = Geometry([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])

# ----
# Grass of Analysis Region
geo_19 = Geometry([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])

boundary_3 = BoundarySurfaces(Edges=rotate.Geometry)
panel_22 = Panel("2 to 3 randomly")
Z_2 = UnitZ(Factor="2.5")
move = Move(Geometry=boundary_3, Motion=Z_2)  # -> Geometry, Transform

dragonfly = DFDragonfly()  # -> Vviiiiiiiiiizzz; plug-in component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
# OUTPUT
# INPUT
ladybug = Ladybug_Ladybug()  # -> Vviiiiiiiiiizzz; plug-in component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

entwine_3 = Entwine(Branch00=geo_4, Branch01=geo_11, Branch02=geo_15, FlattenInputs=True)  # -> simplify(Result)

# ----
# Grass
merge_4 = Merge(Data1=geo_19, Data2=geo_18)
boundary_4 = BoundarySurfaces(Edges=merge_4)

# ----
# 1.0 - INPUT
panel_23 = Panel("Commercial Layout")
entwine_4 = Entwine(Branch00=geo_6, Branch01=geo_12, Branch02=geo_16, FlattenInputs=True)  # -> simplify(Result)

# ----
# 1.0 - INPUT
panel_24 = Panel("Residential Layout")
entwine_5 = Entwine(Branch00=geo_3, Branch01=geo_10, Branch02=geo_14, FlattenInputs=True)  # -> simplify(Result)

# ----
# 1.0 - INPUT
panel_25 = Panel("School Layout")
entwine_6 = Entwine(Branch00=geo_5, Branch01=geo_13, Branch02=geo_17, FlattenInputs=True)  # -> simplify(Result)

offset = OffsetCurve(Curve=entwine_3, Distance="2", Plane=PlaneXY(0, 0, 0), Corners=1)
boundary_5 = BoundarySurfaces(Edges=offset)
preview_2 = CustomPreview(Geometry=flatten(boundary_5), Material=ColourSwatch(SwatchColor=RGBA(88, 88, 252, 76)))

preview_3 = CustomPreview(Geometry=flatten(entwine_4), Material=ColourSwatch(SwatchColor=RGB(255, 0, 0)))

# ----
# ToDO
# TEST
# STEPS
# INFO
# VISUAL
# X
# X
# X
# X
# X
# X
# X
# X
# X
# X
# X
# X
# X
# X
# X
# X
# X
# X
# X
# X
# X
# X
# X
# X
# X
# X
# X
preview_4 = CustomPreview(Geometry=flatten(entwine_5), Material=ColourSwatch(SwatchColor=RGB(255, 0, 0)))

preview_5 = CustomPreview(Geometry=flatten(entwine_6), Material=ColourSwatch(SwatchColor=RGB(255, 0, 0)))

# ----
# Visualize Urban Area
swatch = ColourSwatch(SwatchColor=RGB(82, 82, 82))
preview_6 = CustomPreview(Geometry=boundary_4, Shader=ColourSwatch(SwatchColor=RGB(118, 168, 133)))
preview_7 = CustomPreview(Geometry=move.Geometry, Shader=ColourSwatch(SwatchColor=RGB(99, 255, 144)))
preview_8 = CustomPreview(Geometry=boundary, Shader=swatch)
preview_9 = CustomPreview(Shader=ColourSwatch(SwatchColor=RGB(95, 100, 178)))
preview_10 = CustomPreview(Shader=ColourSwatch(SwatchColor=RGB(235, 206, 94)))
preview_11 = CustomPreview(Shader=ColourSwatch(SwatchColor=RGB(143, 143, 143)))

panel_26 = Panel("Ankara/TUIK")

# ----
# Define Building Typologies
toggle = BooleanToggle(True)
bldg_program = Dragonfly_BldgProgram({"FullServiceRestaurant", "Hospital", "LargeHotel", "LargeOffice", "MediumOffice", "MidRiseApartment", "OutPatient", "PrimarySchool", "QuickServiceRestaurant", "SecondarySchool", "SmallHotel", "SmallOffice", "StandAloneRetail", "StripMall", "SuperMarket", "Warehouse"}, selected="SecondarySchool")
bldg_age = Dragonfly_BldgAge({"Pre-1980's": "Pre1980s", "1980's-Present": "1980sPresent", "New Construction": "NewConstruction"}, selected="1980's-Present")
bldg_program_2 = Dragonfly_BldgProgram({"FullServiceRestaurant", "Hospital", "LargeHotel", "LargeOffice", "MediumOffice", "MidRiseApartment", "OutPatient", "PrimarySchool", "QuickServiceRestaurant", "SecondarySchool", "SmallHotel", "SmallOffice", "StandAloneRetail", "StripMall", "SuperMarket", "Warehouse"}, selected="MidRiseApartment")
bldg_age_2 = Dragonfly_BldgAge({"Pre-1980's": "Pre1980s", "1980's-Present": "1980sPresent", "New Construction": "NewConstruction"}, selected="Pre-1980's")
bldg_program_3 = Dragonfly_BldgProgram({"FullServiceRestaurant", "Hospital", "LargeHotel", "LargeOffice", "MediumOffice", "MidRiseApartment", "OutPatient", "PrimarySchool", "QuickServiceRestaurant", "SecondarySchool", "SmallHotel", "SmallOffice", "StandAloneRetail", "StripMall", "SuperMarket", "Warehouse"}, selected="SmallOffice")
bldg_age_3 = Dragonfly_BldgAge({"Pre-1980's": "Pre1980s", "1980's-Present": "1980sPresent", "New Construction": "NewConstruction"}, selected="1980's-Present")
bldgtypology = DFBuildingTypology(geo=entwine_5, program=bldg_program_2, age=bldg_age_2, flr_to_flr="3", fract_canyon="0.05", run=toggle)  # -> read_me, typology, port, footprints, floors, facades; plug-in component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
bldgtypology_2 = DFBuildingTypology(geo=entwine_6, program=bldg_program, age=bldg_age, flr_to_flr="4", fract_canyon="0.05", run=toggle)  # -> read_me, typology, port, footprints, floors, facades; plug-in component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
bldgtypology_3 = DFBuildingTypology(program=bldg_program_3, age=bldg_age_3, flr_to_flr="3", fract_canyon="0.05", run=toggle)  # -> read_me, typology, port, footprints, floors, facades; plug-in component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

# ----
# How to calculate Albedo!
# Offices have similar architectural design with residential buildings
# Educational building retrofit under climate change and urban heat island effect
panel_27 = Panel("0.6")

# ----
# Educational building retrofit under climate change and urban heat island effect
panel_28 = Panel("0.6")

# ----
# Educational building retrofit under climate change and urban heat island effect
panel_29 = Panel("0.18")

# ----
# Educational building retrofit under climate change and urban heat island effect
panel_30 = Panel("0.25")

# ----
# Listed parameters are determined through visual observation, Google Earth and via personal contact. Values in parenthesis represent the number of buildings.
panel_31 = Panel("2.036")

# ----
# M (Matheos) Santamouris, Environmental Design of Urban Buildings : an integrated approach
panel_32 = Panel("0.23")

# ----
# Integrated Environmental Solutions Limited, Apache-tables user guide IES virtual environment, 6.4, https://www.iesve.com/downloads/help/ve2012/Thermal/ApacheTables.pdf, 2012.
panel_33 = Panel("1.2")

trafficpar = DFTrafficParameters(sensible_heat="4")  # -> traffic_par; plug-in component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

typeenvelope = DFEditTypologyEnvelope(typology=bldgtypology_3.typology, glz_ratio=panel_27, shgc="0.85", wall_alb="0.23", roof_alb="0.35")  # -> read_me, typology; plug-in component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

typeenvelope_2 = DFEditTypologyEnvelope(typology=bldgtypology.typology, glz_ratio=panel_28, shgc="0.85", wall_alb="0.23", roof_alb="0.35")  # -> read_me, typology; plug-in component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

typeenvelope_3 = DFEditTypologyEnvelope(typology=bldgtypology_2.typology, glz_ratio="0.6", shgc="0.85", wall_alb="0.50", roof_alb=panel_29)  # -> read_me, typology; plug-in component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

# ----
# Define Urban Parameters
vegpar = DFVegetationParameters(albedo=panel_30, start_month="4", end_month="10")  # -> vegetation_par; plug-in component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
pavementpar = DFPavementParameters(albedo=panel_32, conductivity=panel_33, vol_heat_cap=panel_31)  # -> pavement_par; plug-in component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

# ----
# Define the City
toggle_2 = BooleanToggle(False)
city = DFCity(
    typologies=flatten([typeenvelope.typology, typeenvelope_2.typology, typeenvelope_3.typology]),
    terrain=flatten(boundary_2),
    trees=flatten(boundary_3),
    grass=flatten(boundary_4),
    climate_zone="4B",
    traffic_par=trafficpar,
    vegetation_par=vegpar,
    pavement_par=pavementpar,
    run=toggle_2)  # -> read_me, port, city, port_2, tree_proj, grass_proj, terrain_proj; plug-in component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
dragonfly_city = Panel(city.city)

# ----
# Import Climate Data
panel_34 = Panel("https://www.energyplus.net/weather-download/europe_wmo_region_6/TUR//TUR_Ankara.171280_IWEC/all")
epw_stat = Ladybug_OpenEPWAndSTATWeatherFiles(weatherFileURL=panel_34)  # -> epwFile, statFile; plug-in component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
analysisperiod = Ladybug_AnalysisPeriod(fromMonth="7", toMonth="7")  # -> readMe, analysisPeriod; plug-in component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
path = FilePath("D:\KBEM\IP1.3\TUR_AN_Esenboga.171280_TMYx.2004-2018.epw")

dragonfly_building_typologies = Panel([typeenvelope.typology, bldgtypology.typology, bldgtypology_2.typology])

refepwpar = DFReferenceEPWParameters(veg_coverage="0.85")  # -> epw_site_par; plug-in component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

bndlayerpar = DFBoundaryLayerParameters()  # -> bnd_layer_par; plug-in component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

# ----
# Run the UWG
panel_35 = Panel("D:\KBEM\IP1.3\Results")
toggle_3 = BooleanToggle(False)
runuwg = DFRunUrbanWeatherGenerator(
    epw_file=path,
    city=city.city,
    epw_site_par=refepwpar,
    bnd_layer_par=bndlayerpar,
    analysis_period=analysisperiod.analysisPeriod,
    folder=panel_35,
    name="300621",
    write=toggle_3,
    run=toggle_3)  # -> read_me, port, urban_epw, port_2, uwg_object; plug-in component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

# ----
# X
# X
# X
# X
# X
# X
# X
# X
# X
# X
# X
# X
# X
# X
# X
# X
# X
# X
# X
# X
# X
# X
# X
# X
# X
# X
# X
# Visualize the Results
importepw = Ladybug_ImportEpw(epwFile=path)  # -> readMe, latitude, location, dryBulbTemperature, dewPointTemperature, relativeHumidity, windSpeed, windDirection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; plug-in component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
importepw_2 = Ladybug_ImportEpw(epwFile=runuwg.urban_epw)  # -> readMe, latitude, location, dryBulbTemperature, dewPointTemperature, relativeHumidity, windSpeed, windDirection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; plug-in component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
selectandaveragedata = Ladybug_AverageData(annualHourlyData=importepw_2.dryBulbTemperature)  # -> readMe, selHourlyData, averagedDaily, averagedMonthly, avrMonthlyPerHour, avrMonthlyMinPerHour, avrMonthlyMaxPerHour; plug-in component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
selectandaveragedata_2 = Ladybug_AverageData(annualHourlyData=importepw.dryBulbTemperature)  # -> readMe, selHourlyData, averagedDaily, averagedMonthly, avrMonthlyPerHour, avrMonthlyMinPerHour, avrMonthlyMaxPerHour; plug-in component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
X = UnitX(Factor="500")
legendpar = Ladybug_LegendParameters(lowBound="26", highBound="36", decimalPlaces="0")  # -> legendPar; plug-in component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
area_8 = Area(Geometry=hull.Hull)  # -> Area, Centroid
move_2 = Move(Geometry=area_8.Centroid, Motion=X)  # -> Geometry, Transform
panel_36 = Panel("""Rural
Urban""")
pt_2 = Point([Point(501.3960769, 275.3960491, 0), Point(501.3960769, -116.6456496, 0)])
_3dchart = Ladybug_3DChart(
    inputData=flatten([selectandaveragedata_2.selHourlyData, selectandaveragedata.selHourlyData]),
    basePoint=move_2.Geometry,
    xScale="2",
    zScale="0",
    legendPar=legendpar)  # -> readMe, graphMesh, graphCurves, legend, legendBasePts, title, titleBasePts, dataPts, conditionalHOY; plug-in component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
tag = TextTag3D(Location=pt_2, Text=panel_36, Size="30", Justification=7)
